# Requirement set TCR (R2024b)

## 1 [TCR] References to TCR.doc (Container)
Read-only references to Microsoft Word document.

### 1.1 [Input Scaling]

#### 1.1.1 [inp_scl_1] Scaled data must be responsive t...
Scaled data must be responsive to full range of input dataa.

#### 1.1.2 [inp_scl_2] Output range for each signal must be normalized.

### 1.2 [PI Controller]

#### 1.2.1 [pi_ctrl_1] Must implement standard proporti...
Must implement standard proportional plus integral control algorithm.

#### 1.2.2 [pi_ctrl_2] Proportional and integral gains ...
Proportional and integral gains should be adjustable.

#### 1.2.3 [pi_ctrl_3] Measures must be taken to preven...
Measures must be taken to prevent windup in integral state.

### 1.3 [PWM Conversion]

#### 1.3.1 [pwm_1] Duty cycle must be proportional ...
Duty cycle must be proportional to controller output, when in a valid range.

#### 1.3.2 [pwm_2] PWM torque should act in positiv...
PWM torque should act in positive sense when controller output is positive or zero.

#### 1.3.3 [pwm_3] PWM torque should act in negativ...
PWM torque should act in negative sense when controller output is negative.

#### 1.3.4 [pwm_4] Duty cycle must be in range from 0 to 1.

### 1.4 [Output Scaling]

#### 1.4.1 [out_scl_1] Scaled data must be responsive t...
Scaled data must be responsive to full range of input data.

#### 1.4.2 [out_scl_2] Output data must be scaled for d...
Output data must be scaled for direct input to driver software.