% Requirement links of pst_deneme.psprjx (R2024a)

item 1 relates to throttleControlReqs.doc#@inp_scl_1: inp_scl_1 in TCR.doc
item 2 relates to TCR.doc#@out_scl_1: out_scl_1 in TCR.doc
item 3 relates to TCR.doc#@out_scl_1: out_scl_1 in TCR.doc
item 4 relates to TCR.doc#@inp_scl_2: inp_scl_2 in TCR.doc
item 5 relates to TCR.doc#@inp_scl_1: inp_scl_1 in TCR.doc
item 6 relates to throttleControlReqs.doc#@inp_scl_2: inp_scl_2 in throttleControlReqs.doc
item 7 relates to TCR.doc#@inp_scl_1: inp_scl_1 in TCR.doc
item 8 relates to TCR.doc#@out_scl_2: out_scl_2 in TCR.doc
item 9 relates to TCR.doc#@out_scl_1: out_scl_1 in TCR.doc
item 10 relates to throttleControlReqs.doc#@inp_scl_1: inp_scl_1 in throttleControlReqs.doc